# Grasshopper definition geometry.gh (Grasshopper 1.0.7)

# ---- group: Geometry
# Layer: !! TO EXPORT CURVES CHOOSE FIRST ACIS Version 4.0 AS STANDARD IN RHINO EXPORT!!
export = Button()
layer = Panel("layer_name")
expobjs = GhPythonScript(L=layer, E=export)  # -> out, a
# ---------- expobjs: Python ----------
"""Provides a scripting component.

    Inputs:

        L: Layer name for bake

        E: Export Activate

    Output:

        a: The a output variable"""

 

__author__ = "ScottD"

__version__ = "2019.08.10"

 

import rhinoscriptsyntax as rs
import scriptcontext as sc
import Rhino, os
import re

if E:
    sc.doc = Rhino.RhinoDoc.ActiveDoc
    
    # get objects to export
    ids = rs.ObjectsByLayer(L)
    
    print(ids)

    rs.UnselectAllObjects()
    rs.SelectObjects(ids)
    
    # modify layer name
    L = re.sub('_A_ABAQUS::', '', L)
    
    # export in folder_of_gh_component\parts
    dir = os.path.dirname(ghenv.Component.OnPingDocument().FilePath)
    
    dir = os.path.join(dir, "parts")
    
    if not os.path.exists(dir):
        os.makedirs(dir)
    
    # filename = layername
    path = os.path.join(dir, L)
    
    # For debugging
    print(path)

    rs.Command('_-Export "' + path + '.sat" _Enter _Enter')

    rs.UnselectAllObjects()
    sc.doc = ghdoc
# ---------- end expobjs ----------
