# Grasshopper definition 4_P_B_Concrete_Beam.gh (Grasshopper 1.0.7)
# plug-ins: sof_gh_sofistik-2022

io = IO(
    SofistikDocumentProperties_VersionMajor="2022",
    SofistikDocumentProperties_VersionMinor="4",
    SofistikDocumentProperties_VersionName="2022")
bake = Button()
export = Button()
beam_length = Slider(120, range=0..240)
beam_width = Slider(10, range=0..50)
beam_height = Slider(10, range=0..50)
support_width = Slider(5, range=0..10)
support_height = Slider(2, range=0..10)
support_distance = Slider(10, range=0..50)
load_width = Slider(5, range=0..10)
load_height = Slider(2, range=0..10)
load_distance = Slider(45, range=0..60)
beam = Beam(beam_length=beam_length, beam_width=beam_width, beam_height=beam_height)
support = Support(support_length=support_width, beam_width=beam_width, support_height=support_height, support_distance=support_distance)  # -> obj_support, vec_rp_support, vecs_dp_support
load = Load(
    beam_width=beam_width,
    load_length=load_width,
    load_height=load_height,
    load_distance=load_distance,
    beam_height=beam_height)  # -> obj_load, vec_rp_load, vecs_dp_support
layer = Panel("concrete_beam")
layer_2 = Panel("support_plate")
layer_3 = Panel("load_plate")
mirror = Mirror(object=beam, beam_length=beam_length)  # -> mirrored_object, mirrored_object_2, mirrored_object_3
mirror_2 = Mirror(object=support.obj_support, object_2=support.vec_rp_support, object_3=support.vecs_dp_support, beam_length=beam_length)  # -> mirrored_object, mirrored_object_2, mirrored_object_3
mirror_3 = Mirror(object=load.obj_load, object_2=load.vec_rp_load, object_3=load.vecs_dp_support, beam_length=beam_length)  # -> mirrored_object, mirrored_object_2, mirrored_object_3
py_bake = GhPythonScript(G=[beam, mirror.mirrored_object], L=layer, B=bake)  # -> out, a
# ---------- py_bake: Python ----------
"""Provides a scripting component.

    Inputs:

        G: Geometry to bake

        L: Layer name for bake

        B: Bake Activate

    Output:

        a: The a output variable"""

 

__author__ = "ScottD"

__version__ = "2019.08.10"

 

import rhinoscriptsyntax as rs

import scriptcontext

import Rhino

 

 

if B:

    print(type(G))  # debug message to Python output

    # we obtain the reference in the Rhino doc

    doc_object = scriptcontext.doc.Objects.Find(G)

    print(type(doc_object))

    attributes = doc_object.Attributes

    # debug message to Python output
    print('the type of attributes is: ' + str(type(attributes)))

    geometry = doc_object.Geometry

    # debug message to Python output
    print('the type of geometry is: ' + str(type(doc_object)))

    # we change the scriptcontext

    scriptcontext.doc = Rhino.RhinoDoc.ActiveDoc

    # we add both the geometry and the attributes to the Rhino doc

    rhino_brep = scriptcontext.doc.Objects.Add(geometry, attributes)

    # debug message to Python output
    print('the Rhino doc ID is: ' + str(rhino_brep))

    # we can for example change the layer in Rhino...

    if not rs.IsLayer(L):

        rs.AddLayer(L)

    rs.ObjectLayer(rhino_brep, L)

    # we put back the original Grasshopper document as default

    scriptcontext.doc = ghdoc

    a = G
# ---------- end py_bake ----------
py_bake_2 = GhPythonScript(G=[support.obj_support, mirror_2.mirrored_object], L=layer_2, B=bake)  # -> out, a; same code as py_bake
py_bake_3 = GhPythonScript(G=[load.obj_load, mirror_3.mirrored_object], L=layer_3, B=bake)  # -> out, a; same code as py_bake
py_ex_pt = GhPythonScript(
    L=layer_2,
    vec_rp=[support.vec_rp_support, mirror_2.mirrored_object_2],
    vec_dp=[mirror_2.mirrored_object_3, support.vecs_dp_support],
    E=export)  # -> out, a; inputs vec_rp: list, vec_dp: list
#   port vec_rp: Vector to export
# ---------- py_ex_pt: Python ----------
"""Provides a scripting component.

    Inputs:

        L: Layer name for export

        V: Reference point to export

        V: Data plane origin to export

        E: Export Activate

    Output:

        a: The a output variable"""

 

__author__ = "ScottD"

__version__ = "2019.08.10"

 

import rhinoscriptsyntax as rs
import scriptcontext as sc
import Rhino, os

if E:
    # export in folder_of_gh_component\parts
    dir = os.path.dirname(os.path.dirname(ghenv.Component.OnPingDocument().FilePath))
    
    dir = os.path.join(dir, "parts")
    
    if not os.path.exists(dir):
        os.makedirs(dir)
        
    for i, v in enumerate(vec_rp):
        path = os.path.join(dir, (L + '-' +  str(i)) + '.rp')
 
        with open(path, "w")as file:
            file.write(str(v)+ "\n")
            
    for i, v in enumerate(vec_dp):
        path = os.path.join(dir, (L + '-' +  str(i)) + '.dp')
 
        with open(path, "w")as file:
            file.write(str(v)+ "\n")
# ---------- end py_ex_pt ----------
py_ex_pt_2 = GhPythonScript(
    L=layer_3,
    vec_rp=[mirror_3.mirrored_object_2, load.vec_rp_load],
    vec_dp=[mirror_3.mirrored_object_3, load.vecs_dp_support],
    E=export)  # -> out, a; inputs vec_rp: list, vec_dp: list; same code as py_ex_pt
py_ex_obj = GhPythonScript(L=layer_2, E=export)  # -> out, a
# ---------- py_ex_obj: Python ----------
"""Provides a scripting component.

    Inputs:

        L: Layer name for bake

        E: Export Activate

    Output:

        a: The a output variable"""

 

__author__ = "ScottD"

__version__ = "2019.08.10"

 

import rhinoscriptsyntax as rs
import scriptcontext as sc
import Rhino, os

if E:
    sc.doc = Rhino.RhinoDoc.ActiveDoc
    
    # get objects to export
    ids = rs.ObjectsByLayer(L)

    rs.UnselectAllObjects()
    rs.SelectObjects(ids)
    
    # export in folder_of_gh_component\parts
    dir = os.path.dirname(os.path.dirname(ghenv.Component.OnPingDocument().FilePath))
    
    dir = os.path.join(dir, "parts")
    
    if not os.path.exists(dir):
        os.makedirs(dir)
    
    # filename = layername
    path = os.path.join(dir, L)
    
    # For debugging
    print(path)

    rs.Command('_-Export "' + path + '.sat" _Enter _Enter')

    rs.UnselectAllObjects()
    sc.doc = ghdoc
# ---------- end py_ex_obj ----------
py_ex_obj_2 = GhPythonScript(L=layer, E=export)  # -> out, a; same code as py_ex_obj
py_ex_obj_3 = GhPythonScript(L=layer_3, E=export)  # -> out, a; same code as py_ex_obj

# ==== cluster Beam
io = IO(
    SofistikDocumentProperties_VersionMajor="2022",
    SofistikDocumentProperties_VersionMinor="4",
    SofistikDocumentProperties_VersionName="2022")
beam_length = ClusterInput()
beam_width = ClusterInput()
beam_height = ClusterInput()
division = Division(A=beam_length, B=2)
rectangle = Rectangle(Plane=PlaneXY(0, 0, 0), XSize=division, YSize=beam_width, Radius=0)  # -> Rectangle, Length
boxrec = BoxRectangle(Rectangle=rectangle.Rectangle, Height=beam_height)
obj_beam = ClusterOutput(boxrec)

# ==== cluster Support
io = IO(
    SofistikDocumentProperties_VersionMajor="2022",
    SofistikDocumentProperties_VersionMinor="4",
    SofistikDocumentProperties_VersionName="2022")
support_length = ClusterInput()
beam_width = ClusterInput()
support_height = ClusterInput()
support_distance = ClusterInput()
division = Division(A=support_length, B=2)
division_2 = Division(A=beam_width, B=2)
subtraction = Subtraction(A=support_distance, B=division)
x_1 = Multiplication(A=support_height, B=-1)
subtraction_2 = Subtraction(A=support_distance, B=division)
addition = Addition(A=support_distance, B=division)
rectangle = Rectangle(Plane=PlaneXY(0, 0, 0), XSize=support_length, YSize=beam_width, Radius=0)  # -> Rectangle, Length
vec = VectorXYZ(XComponent=subtraction, YComponent=0, ZComponent=x_1)  # -> Vector, Length
vec_2 = VectorXYZ(XComponent=support_distance, YComponent=division_2, ZComponent=x_1)  # -> Vector, Length
vec_3 = VectorXYZ(XComponent=subtraction_2, YComponent=0, ZComponent=0)  # -> Vector, Length
vec_4 = VectorXYZ(XComponent=support_distance, YComponent=0, ZComponent=0)  # -> Vector, Length
vec_5 = VectorXYZ(XComponent=addition, YComponent=0, ZComponent=0)  # -> Vector, Length
boxrec = BoxRectangle(Rectangle=rectangle.Rectangle, Height=support_height)
move = Move(Geometry=boxrec, Motion=vec.Vector)  # -> Geometry, Transform
obj_support = ClusterOutput(move.Geometry)
vec_rp_support = ClusterOutput(vec_2.Vector)
vecs_dp_support = ClusterOutput([vec_3.Vector, vec_4.Vector, vec_5.Vector])

# ==== cluster Load
io = IO(
    SofistikDocumentProperties_VersionMajor="2022",
    SofistikDocumentProperties_VersionMinor="4",
    SofistikDocumentProperties_VersionName="2022")
beam_width = ClusterInput()
load_length = ClusterInput()
load_height = ClusterInput()
load_distance = ClusterInput()
beam_height = ClusterInput()
division = Division(A=load_length, B=2)
division_2 = Division(A=beam_width, B=2)
addition = Addition(A=load_height, B=beam_height)
subtraction = Subtraction(A=load_distance, B=division)
addition_2 = Addition(A=load_distance, B=division)
subtraction_2 = Subtraction(A=load_distance, B=division)
rectangle = Rectangle(Plane=PlaneXY(0, 0, 0), XSize=load_length, YSize=beam_width, Radius=0)  # -> Rectangle, Length
vec = VectorXYZ(XComponent=load_distance, YComponent=division_2, ZComponent=addition)  # -> Vector, Length
vec_2 = VectorXYZ(XComponent=subtraction, YComponent=0, ZComponent=0)  # -> Vector, Length
vec_3 = VectorXYZ(XComponent=load_distance, YComponent=0, ZComponent=0)  # -> Vector, Length
vec_4 = VectorXYZ(XComponent=addition_2, YComponent=0, ZComponent=0)  # -> Vector, Length
vec_5 = VectorXYZ(XComponent=subtraction_2, YComponent=0, ZComponent=beam_height)  # -> Vector, Length
boxrec = BoxRectangle(Rectangle=rectangle.Rectangle, Height=load_height)
move = Move(Geometry=boxrec, Motion=vec_5.Vector)  # -> Geometry, Transform
vec_rp_load = ClusterOutput(vec.Vector)
vecs_dp_support = ClusterOutput([vec_2.Vector, vec_3.Vector, vec_4.Vector])
obj_load = ClusterOutput(move.Geometry)

# ==== cluster Mirror
io = IO(
    SofistikDocumentProperties_VersionMajor="2022",
    SofistikDocumentProperties_VersionMinor="4",
    SofistikDocumentProperties_VersionName="2022")
object = ClusterInput()
object_2 = ClusterInput()
object_3 = ClusterInput()
beam_length = ClusterInput()
division = Division(A=beam_length, B=2)
vec = VectorXYZ(XComponent=division, YComponent=0, ZComponent=0)  # -> Vector, Length
yz = YZPlane(Origin=vec.Vector)
mirror = Mirror(Geometry=object, Plane=yz)  # -> Geometry, Transform
mirror_2 = Mirror(Geometry=object_2, Plane=yz)  # -> Geometry, Transform
mirror_3 = Mirror(Geometry=object_3, Plane=yz)  # -> Geometry, Transform
pdecon = Deconstruct(Point=mirror_2.Geometry)  # -> XComponent, YComponent, ZComponent
pdecon_2 = Deconstruct(Point=mirror_3.Geometry)  # -> XComponent, YComponent, ZComponent
vec_2 = VectorXYZ(XComponent=pdecon.XComponent, YComponent=pdecon.YComponent, ZComponent=pdecon.ZComponent)  # -> Vector, Length
vec_3 = VectorXYZ(XComponent=pdecon_2.XComponent, YComponent=pdecon_2.YComponent, ZComponent=pdecon_2.ZComponent)  # -> Vector, Length
mirrored_object = ClusterOutput(mirror.Geometry)
mirrored_object_2 = ClusterOutput(vec_2.Vector)
mirrored_object_3 = ClusterOutput(vec_3.Vector)
