# Grasshopper definition 230227_Bauteil.gh (Grasshopper 1.0.7)

# ----
# Layer: !! TO EXPORT CURVES CHOOSE FIRST ACIS Version 4.0 AS STANDARD IN RHINO EXPORT!!
toggle = BooleanToggle(False)
layer = Panel("_A_ABAQUS::C_concrete")
layer_2 = Panel("_A_ABAQUS::R_reinforcement")
expobjs = GhPythonScript(L=layer, E=toggle)  # -> out, a
# ---------- expobjs: Python ----------
"""Provides a scripting component.

    Inputs:

        L: Layer name for bake

        E: Export Activate

    Output:

        a: The a output variable"""

 

__author__ = "ScottD"

__version__ = "2019.08.10"

 

import rhinoscriptsyntax as rs
import scriptcontext as sc
import Rhino, os
import re

if E:
    sc.doc = Rhino.RhinoDoc.ActiveDoc
    
    # get objects to export
    ids = rs.ObjectsByLayer(L)
    
    print(ids)

    rs.UnselectAllObjects()
    rs.SelectObjects(ids)
    
    # modify layer name
    L = re.sub('_A_ABAQUS::', '', L)
    
    # export in folder_of_gh_component\parts
    dir = os.path.dirname(ghenv.Component.OnPingDocument().FilePath)
    
    dir = os.path.join(dir, "parts")
    
    if not os.path.exists(dir):
        os.makedirs(dir)
    
    # filename = layername
    path = os.path.join(dir, L)
    
    # For debugging
    print(path)

    rs.Command('_-Export "' + path + '.sat" _Enter _Enter')

    rs.UnselectAllObjects()
    sc.doc = ghdoc
# ---------- end expobjs ----------
expobjs_2 = GhPythonScript(L=layer_2, E=toggle)  # -> out, a; same code as expobjs

# ----
# Layer: !! TO EXPORT CURVES CHOOSE FIRST ACIS Version 4.0 AS STANDARD IN RHINO EXPORT!!
toggle_2 = BooleanToggle(False)
layer_3 = Panel("_A_ABAQUS::D_REFERENCE_POINTS")
layer_4 = Panel("_A_ABAQUS::D_DATUM_PLANES")
exprp = GhPythonScript(L=layer_3, E=toggle_2)  # -> out, a
# ---------- exprp: Python ----------
__author__ = "ScottD"
__version__ = "2019.08.10"

"""Provides a scripting component.
    Inputs:
        L: Layer name for bake
        E: Export Activate

    Output:
        a: The a output variable"""
 

import rhinoscriptsyntax as rs
import scriptcontext as sc
import Rhino, os
import re

if True:
    sc.doc = Rhino.RhinoDoc.ActiveDoc
    
    # get objects to export
    filt=rs.filter.point
    ids=[obj for obj in rs.ObjectsByLayer(L) if rs.ObjectType(obj)==filt]
    
#    print(ids)
        
    # modify layer name
    L = re.sub('_A_ABAQUS::', '', L)
    
    # export in folder_of_gh_component\parts
    dir = os.path.dirname(os.path.dirname(ghenv.Component.OnPingDocument().FilePath))
    
    dir = os.path.join(dir, "geometry", "parts")
    
    if not os.path.exists(dir):
        os.makedirs(dir)
        
    # get point coordinates and user defined attributes
    points = []
    rp_types = []
    for i, p in enumerate(ids):
        points.append(rs.PointCoordinates(p))
        rp_types.append(rs.GetUserText(p, "rp_type"))
    
    # sort first by x coordinates of point
    points, rp_types = zip(*sorted(zip(points, rp_types)))
    
    # export
    for i, p in enumerate(points):
        
        # create path
        path = os.path.join(dir, ("RP" + '-' +  str(i+1)) + '.rp')
        
        # get user attributes
        rp_type = rp_types[i]
 
        # export both
        with open(path, "w")as file:
            file.write(str(p) + "," + rp_type + "\n")

            
    rs.UnselectAllObjects()
    sc.doc = ghdoc
# ---------- end exprp ----------
expdp = GhPythonScript(L=layer_4, E=toggle_2)  # -> out, a
# ---------- expdp: Python ----------
__author__ = "ScottD"
__version__ = "2019.08.10"

"""Provides a scripting component.
    Inputs:
        L: Layer name for bake
        E: Export Activate

    Output:
        a: The a output variable"""
 

import rhinoscriptsyntax as rs
import scriptcontext as sc
import Rhino, os
import re

if E:
    sc.doc = Rhino.RhinoDoc.ActiveDoc
    
    # get objects to export
    filt=rs.filter.surface
    ids=[obj for obj in rs.ObjectsByLayer(L) if rs.ObjectType(obj)==filt]
    
    print(ids)
    
    # modify layer name
    L = re.sub('_A_ABAQUS::', '', L)
    
    # export in folder_of_gh_component\parts
    dir = os.path.dirname(os.path.dirname(ghenv.Component.OnPingDocument().FilePath))
    
    dir = os.path.join(dir, "geometry", "parts")
    
    if not os.path.exists(dir):
        os.makedirs(dir)
        
    for i, s in enumerate(ids):
        # Get center point
        point = rs.SurfaceAreaCentroid(s)[0]
        
        # get local coordinates at point
        u,v = rs.SurfaceClosestPoint(s, point)
        
        # get normal vector at point
        n = rs.SurfaceNormal(s, [u,v])

        path = os.path.join(dir, ("DP" + '-' +  str(i+1)) + '.dp')
        print(path)
 
        with open(path, "w")as file:
            file.write(str(point) + "," + str(n) + "\n")
            
    rs.UnselectAllObjects()
    sc.doc = ghdoc
# ---------- end expdp ----------
